# Grasshopper definition Grasshopper Script - C#.gh (Grasshopper 1.0.7)

curve = Curve(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)
surface = Surface(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)
surface_2 = Surface(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)
c_script = CSharpScript(
    BoundaryCurve=curve,
    BottomSurface=surface,
    TopSurface=surface_2,
    CountX=Slider(18, range=0..50),
    CountY=Slider(25, range=0..50),
    DistanceX=Slider(10, range=0..50),
    DistanceY=Slider(10, range=0..50),
    Probability=Slider(9, range=0..10),
    RandomSeed=Slider(2, range=0..10),
    MaxTilt=Slider(7, range=0..10),
    BlockW=Slider(7, range=0..50),
    BlockD=Slider(5, range=0..50))  # -> out, Grid, BasePlanes, Concreat; inputs BoundaryCurve: Curve, BottomSurface: Brep, TopSurface: Brep, CountX: Int32, CountY: Int32, DistanceX: Double, DistanceY: Double, Probability: Double, RandomSeed: Int32, MaxTilt: Double, BlockW: Double, BlockD: Double
# ---------- c_script: C# ----------
    Print("Hello World!");


    // Let's Generate the points ;)
    List<Point3d> BasePoint = new List <Point3d> ();
    for(int i = 0; i < CountX; i++){
      for (int j = 0; j < CountY; j++){
        double x = DistanceX * i;
        double y = DistanceY * j;
        Point3d p = new Point3d(x, y, 0);
        BasePoint.Add(p);
      }
    }

    // check if the curve is planery
    if (!BoundaryCurve.IsPlanar()){
      Component.AddRuntimeMessage(GH_RuntimeMessageLevel.Error, "Dude, we need a planery curve");
    }
    Plane CurvePlane;
    BoundaryCurve.TryGetPlane(out CurvePlane);

    // cull points in the boundary curve
    List<Point3d> CulledPoints = new List <Point3d> ();
    foreach (Point3d p in BasePoint){
      PointContainment pc = BoundaryCurve.Contains(p, CurvePlane, 0.001);
      if (pc == PointContainment.Inside){
        CulledPoints.Add(p);
      }
    }

    // Cull Points close to the BoundaryCurve
    List<Point3d> RandomCulledPoints = new List <Point3d> ();
    Random rnd = new Random(RandomSeed);
    foreach (Point3d p in CulledPoints ){
      double t = 0;
      BoundaryCurve.ClosestPoint(p, out t);
      Point3d poc = BoundaryCurve.PointAt(t);
      double dist = poc.DistanceTo(p);
      double invert = 1.0 / dist;
      double r = rnd.NextDouble() * Probability;
      if (r > invert){
        RandomCulledPoints.Add(p);
      }
    }

    // project points on the bottom Surface
    List <Brep> BtSurface = new List <Brep> ();
    BtSurface.Add(BottomSurface);
    Point3d [] PtaBottom = Rhino.Geometry.Intersect.Intersection.ProjectPointsToBreps(
      BtSurface,
      RandomCulledPoints,
      -Vector3d.ZAxis,
      0.001);

    // project points on the Top Surface
    List <Brep> TpSurface = new List <Brep> ();
    TpSurface.Add(TopSurface);
    Point3d [] PtaTop = Rhino.Geometry.Intersect.Intersection.ProjectPointsToBreps(
      TpSurface,
      RandomCulledPoints,
      Vector3d.ZAxis,
      0.001);

    // Tilting The Planes
    Plane [] BtPlanes = new Plane [PtaBottom.Length];
    for (int i = 0; i < PtaBottom.Length; i++ ){
      Plane pl = Plane.WorldXY;
      pl.Origin = PtaBottom[i];

      double ToDegree = 2 * Math.PI / 360;
      double RandomAngle = ToDegree * rnd.NextDouble();
      double RandomTiltAngle = MaxTilt * ToDegree * rnd.NextDouble();
      Vector3d vx = pl.XAxis;
      vx.Rotate(RandomAngle, Vector3d.ZAxis);
      pl.Rotate(RandomTiltAngle, vx, pl.Origin);
      BtPlanes[i] = pl;      
    }
    
    //Generating Concrete Boxes
    Box[] ConcreatBoxes = new Box [BtPlanes.Length];
    for (int i = 0; i < BtPlanes.Length ; i++ ){
      double dist = PtaBottom[i].DistanceTo(PtaTop[i]);
      Box c = new Box (
        BtPlanes[i],
        new Interval(-0.5 * BlockD, 0.5 * BlockD),
        new Interval(-0.5 * BlockW, 0.5 * BlockW),
        new Interval(0, dist));
      ConcreatBoxes[i] = c;
    }

    Grid = PtaBottom;
    BasePlanes = BtPlanes;
    Concreat = ConcreatBoxes;
# ---------- end c_script ----------
create_material = CreateMaterial(Diffuse="white", Specular=RGB(255, 255, 255), Emission=RGB(0, 0, 0), Transparency=0, Shine=0)
point = Point(c_script.Grid)
plane = Plane(c_script.BasePlanes)
geometry = Geometry(c_script.Concreat)
custom_preview = CustomPreview(Geometry=geometry, Material=create_material)
panel = Panel(c_script.out)
