# Grasshopper definition csv to geometry.gh (Grasshopper 1.0.7)

panel = Panel("C:\Users\hanie\OneDrive\Desktop\Parametric Camp\Coding Gem\motion_02.csv")
c_script = CSharpScript(csvPath=panel)  # -> out, toPlans; inputs csvPath: String
# ---------- c_script: C# ----------
    // calling the csv file in the computer
    string[] csvLines = System.IO.File.ReadAllLines(csvPath);

    // creating empty lists to save data
    var originPln = new List<Plane>();


    // going over each line
    for (int i = 1; i < csvLines.Length;i++){
      //spliting the lines using comma
      string [] data = csvLines[i].Split(',');

      //getting the origing points
      double originX = Convert.ToDouble(data[1]);
      double originY = Convert.ToDouble(data[2]);
      double originZ = Convert.ToDouble(data[3]);
      Point3d pt = new Point3d(originX, originY, originZ);
      
      //getting the first vector
      double VectorOneX = Convert.ToDouble(data[4]);
      double VectorOneY = Convert.ToDouble(data[5]);
      double VectorOneZ = Convert.ToDouble(data[6]);
      Vector3d vectorOne = new Vector3d(VectorOneX, VectorOneY, VectorOneZ);

      //getting the second vector
      double VectorTwoX = Convert.ToDouble(data[7]);
      double VectorTwoY = Convert.ToDouble(data[8]);
      double VectorTwoZ = Convert.ToDouble(data[9]);
      Vector3d vectorTwo = new Vector3d(VectorTwoX, VectorTwoY, VectorTwoZ);
      
      Plane Pln = new Plane(pt, vectorOne, vectorTwo);
      originPln.Add(Pln);
    }

    toPlans = originPln;
# ---------- end c_script ----------
geo = Geometry(c_script.toPlans)
panel_2 = Panel(c_script.out)
