# Grasshopper definition Galapagos.gh (Grasshopper 1.0.7)

number_slider = Slider(20.29, range=5..100)
crv = Curve(<curve referenced from the Rhino model>)
number_slider_2 = Slider(15, range=0..100)
divdist = DivideDistance(Curve=crv, Distance=number_slider)  # -> Points, Tangents, Parameters
division = Division(A=number_slider, B=2)
split = SplitList(List=divdist.Points, Index=number_slider_2)  # -> ListA, ListB
dedomain = DeconstructDomain(Domain=crv)  # -> Start, End
item = ListItem(List=split.ListA, Index=0, Wrap=True)  # -> Item1, Item
sph = Sphere(Base=split.ListA, Radius=division)
lng = ListLength(List=sph)
crv_cp = CurveClosestPoint(Point=item.Item1, Curve=crv)  # -> Point, Parameter, Distance
division_2 = Division(A=dedomain.End, B=number_slider_2)
subtraction = Subtraction(A=number_slider_2, B=lng)
subtraction_2 = Subtraction(A=dedomain.End, B=crv_cp.Parameter)
panel = Panel(division_2)
multiplication = Multiplication(A=subtraction, B=Slider(20, range=0..100))
galapagos = Galapagos(fitness=num, gene=number_slider)
addition = Addition(A=subtraction_2, B=multiplication)
num = Number(addition)
panel_2 = Panel(num)
