# Grasshopper definition Lumbrace_autosave.gh (Grasshopper 1.0.7)

number_slider = Slider(0.6, range=0..10)
pt = ConstructPoint(XCoordinate=0, YCoordinate=0, ZCoordinate=0)

c_script = CSharpScript(
    startPt=pt,
    width=Slider(64, range=0..100),
    depth=Slider(11, range=0..100),
    hight=Slider(49, range=0..100),
    hight1=Slider(8, range=0..100),
    hight3=Slider(14, range=0..100),
    offset=Slider(5, range=0..100),
    ribsN=Slider(60, range=0..100),
    arrayN=Slider(5, range=0..100),
    radius=Slider(0.1, range=0..10),
    beamMiddleW=Slider(0.4, range=0..10),
    beamH=number_slider,
    beamW=Slider(2.6, range=0..10),
    middleBeamW=Slider(0.7, range=0..10),
    middleBeamH=number_slider,
    middleBeamMiddleW=Slider(0.2, range=0..10))  # -> out, mainArches, subArches, left, console, mainBeam, middleBeam, ribBeam; inputs startPt: Point3d, width: Double, depth: Double, hight: Double, hight1: Double, hight3: Double, offset: Double, ribsN: Int32, arrayN: Int32, radius: Double, beamMiddleW: Double, beamH: Double, beamW: Double, middleBeamW: Double, middleBeamH: Double, middleBeamMiddleW: Double
# ---------- c_script: C# ----------
  /*moving the start point to get the middle and end point
  of the first curve and create an interpolated curve
  with 3 points */

    // getting the end point
    Point3d endPt = new Point3d(startPt.X, startPt.Y + width, startPt.Z);  // generating the end point
    // getting the middle point
    Point3d middlePt = new Point3d(startPt.X, startPt.Y + (width / 2), startPt.Z + hight);  // generating the middle point
    // creating a list of point 3d as the required data for interpolated curve command
    List < Point3d > firstCrvPt = new List<Point3d>{startPt,middlePt,endPt};
    // generating the first interpolated curve
    Curve firstCrv = Rhino.Geometry.Curve.CreateInterpolatedCurve(firstCrvPt, 3);  // creating the first interpolated curve


    /* moving the first created curve in a data tree structure
    with depth and arrayN */

    // creating a data tree of arches
    DataTree<Curve> arches = new DataTree<Curve>();
    // creating a data tree for the beams
    DataTree<Brep> beams = new DataTree<Brep>();

    // for loop for moving the arch arrayN+1 times
    for (int i = 0; i < arrayN + 1; i++ ){
      // get a copy from the first curve to move
      Curve curve = firstCrv.DuplicateCurve();
      // moving command
      curve.Translate(depth * i, 0, 0); // translate command needs a vector to move the object
      // adding the moved curve to a single branch of the data tree
      GH_Path path = new GH_Path(i); // path of the branches
      arches.Add(curve, path);

      // getting 3 frames at the middle, end and start of the point
      List<double> tList = new List<double>{0,(curve.Domain.Length) / 2, curve.Domain.Length};
      Plane[] prepPln = curve.GetPerpendicularFrames(tList);
      Rectangle3d prepRectangle0 = new Rectangle3d(prepPln[0],
        new Interval(-beamW * 0.5, beamW * 0.5),
        new Interval(-beamH * 0.5, beamH * 0.5));
      Rectangle3d prepRectangle1 = new Rectangle3d(prepPln[1],
        new Interval(-beamMiddleW * 0.5, beamMiddleW * 0.5),
        new Interval(-beamH * 0.5, beamH * 0.5));
      Rectangle3d prepRectangle2 = new Rectangle3d(prepPln[2],
        new Interval(-beamW * 0.5, beamW * 0.5),
        new Interval(-beamH * 0.5, beamH * 0.5));

      List <Curve> brepShapes = new List<Curve>{prepRectangle0.ToNurbsCurve(),
          prepRectangle1.ToNurbsCurve(),
          prepRectangle2.ToNurbsCurve()};
      Brep[] beam = Rhino.Geometry.Brep.CreateFromSweep(curve, brepShapes, false, 0.001);
      beams.AddRange(beam);
    }

  /* moving the middle point of the first curve
   to get three other points and creat the second curve*/

    //getting the middle point of the second curve
    Point3d secondPt = new Point3d(middlePt.X + (depth / 2), middlePt.Y, middlePt.Z + (hight1));
    /* moving the start point to hight3,
    getting the closest point to the first curve,
    and moving the aformentioned point to the depth*/
    // duplicating from the start point to move
    Point3d ptWithHight = new Point3d(startPt);
    //moving the created duplicate to the hight3
    //cannot use translate for point3d
    Transform ptHight = Rhino.Geometry.Transform.Translation(0, 0, hight3); // creating the translation vector
    ptWithHight.Transform(ptHight); // Transform instead of translate!
    //get the closest point of the point in the hight3 to the first curve
    double ptOnCrvT;
    // creating the closest point using t parameter
    firstCrv.ClosestPoint(ptWithHight, out ptOnCrvT);
    Point3d ptOnCrv = firstCrv.PointAt(ptOnCrvT);
    // moving the point
    Transform ptdepth = Rhino.Geometry.Transform.Translation(depth / 2, 0, 0);
    ptOnCrv.Transform(ptdepth);
    // getting the first point of the middle curve
    Point3d firstPt = ptOnCrv;
    // getting the end point of the middle point through mirroring the first point
    Plane mirrorPln = new Plane(middlePt, Vector3d.YAxis);
    Transform thirdPtTransform = Rhino.Geometry.Transform.Mirror(mirrorPln);
    ptOnCrv.Transform(thirdPtTransform);
    Point3d thridPt = ptOnCrv;
    // creating a list of three points as the input data for interpolated curve
    List < Point3d > secondCrvPt = new List<Point3d>{firstPt,secondPt,thridPt};
    // middle curve
    Curve secondCrv = Rhino.Geometry.Curve.CreateInterpolatedCurve(secondCrvPt, 3);


    /* moving the first created curve in a data tree structure
    with depth and arrayN */

    // creating a data tree of middle arches
    DataTree<Curve> middleArches = new DataTree<Curve>();
    // creating a data tree for the beams
    DataTree<Brep> middleBeams = new DataTree<Brep>();
    // for loop for moving the arch arrayN times
    for (int i = 0; i < arrayN ; i++ ){
      // get a copy from the first curve to move
      Curve curve = secondCrv.DuplicateCurve();
      // moving the duplicated cur
      curve.Translate(depth * i, 0, 0);
      // add it to the data tree
      GH_Path path = new GH_Path(i); // path of the branches
      middleArches.Add(curve, path);

      // getting 3 frames at the middle, end and start of the point
      List<double> tList = new List<double>{0,(curve.Domain.Length) / 2, curve.Domain.Length};
      Plane[] prepPln = curve.GetPerpendicularFrames(tList);
      Rectangle3d prepRectangle0 = new Rectangle3d(prepPln[0],
        new Interval(-middleBeamW * 0.5, middleBeamW * 0.5),
        new Interval(-middleBeamH * 0.5, middleBeamH * 0.5));
      Rectangle3d prepRectangle1 = new Rectangle3d(prepPln[1],
        new Interval(-middleBeamMiddleW * 0.5, middleBeamMiddleW * 0.5),
        new Interval(-beamH * 0.5, beamH * 0.5));
      Rectangle3d prepRectangle2 = new Rectangle3d(prepPln[2],
        new Interval(-middleBeamW * 0.5, middleBeamW * 0.5),
        new Interval(-middleBeamH * 0.5, middleBeamH * 0.5));

      List <Curve> brepShapes = new List<Curve>{prepRectangle0.ToNurbsCurve(),
          prepRectangle1.ToNurbsCurve(),
          prepRectangle2.ToNurbsCurve()};
      Brep[] beam = Rhino.Geometry.Brep.CreateFromSweep(curve, brepShapes, false, 0.001);
      middleBeams.AddRange(beam);

    }

    /* operating offset in end and start of each arch in the data tree,
    dividing curves,
    and creating the ribs */

    // creating a cutting point>> plane>> surface to split the curve to control the hight of offset
    Point3d cuttingPt = new Point3d(startPt.X, startPt.Y, startPt.Z + offset);
    Plane cuttingPln = new Plane(cuttingPt, Vector3d.ZAxis);
    PlaneSurface cuttingSrf = new PlaneSurface(cuttingPln, new Interval(0, depth * arrayN), new Interval(0, width));

    // creating data tree for arch curve dividing points
    DataTree<Point3d> ribPts = new DataTree<Point3d>();
    // creating data tree for middle arch curve dividing points
    DataTree<Point3d> middleRibPts = new DataTree<Point3d>();

    // a for loop to go over each curve for offsetting and diving the curve
    for (int i = 0; i < arrayN + 1; i++ ){
      // getting each curve in the arches data tree
      Curve curve = arches.Branches[i][0];
      // splitting the curve using the created cutting surface
      Curve[] splittedCurve = curve.Split(cuttingSrf, 0.0001, 0.0001);
      //creating an array of points for middle arch divided points
      Point3d[] ribsPts = new Point3d[ribsN - 1];
      // dividing the middle splitted curve
      splittedCurve[1].DivideByCount(ribsN - 1, true, out ribsPts);
      // creating a path for created point
      GH_Path path = new GH_Path(i);
      // adding points to the data tree
      for(int j = 0; j < ribsPts.Length; j++){
        ribPts.Add(ribsPts[j], path);
      }
      //dividing the middle arches
      // the number of middle arches are one less than the number of arrayN
      if (i != arrayN){
        // getting the middle arches of the middleArches data tree
        Curve middleCurve = middleArches.Branches[i][0];
        // creating an array of middle points
        Point3d[] middleRibsPts = new Point3d[ribsN - 1];
        // dividign middle arches
        middleCurve.DivideByCount(ribsN - 1, true, out middleRibsPts);
        // adding middle points to the data tree
        for(int j = 0; j < ribsPts.Length; j++){
          middleRibPts.Add(middleRibsPts[j], path);
        }
      }
    }

    /* going over each data tree of points,
    creating the lines,
    and adding them to the  */

    // creating data tree for the final line ribs
    DataTree<Line> Ribs = new DataTree<Line>();
    // creating data tree for the final line ribs
    DataTree<Brep> ribBeams = new DataTree<Brep>();

    // a nested for loop for going over branches and values
    for (int j = 0; j < arrayN; j++){
      for(int i = 0; i < ribsN; i++ ){
        // creating the first path for left ribs
        int[] pathIndex = new int[2]{j,0};
        GH_Path path = new GH_Path(pathIndex);
        // creating the left ribs lines
        Line leftRib = new Line(ribPts.Branches[j][i],
          middleRibPts.Branches[j][i]);
        // adding left ribs to the ribs data tree
        Ribs.Add(leftRib, path);

        //creating the beam
        PipeCapMode cap = Rhino.Geometry.PipeCapMode.Flat;
        Brep[] leftBeam = Brep.CreatePipe(leftRib.ToNurbsCurve(), radius, false, cap, true, 0.001, 0.001);
        ribBeams.AddRange(leftBeam, path);

        // creating the second path for right ribs
        pathIndex = new int[2]{j,1};
        path = new GH_Path(pathIndex);
        // creating the right ribs
        Line rightRib = new Line(ribPts.Branches[j + 1][i],
          middleRibPts.Branches[j][i]);
        // adding the right ribs to the ribs data tree
        Ribs.Add(rightRib, path);

        //creating the beam
        Brep[] rightBeam = Brep.CreatePipe(rightRib.ToNurbsCurve(), radius, false, cap, true, 0.001, 0.001);
        ribBeams.AddRange(rightBeam, path);
      }
    }





    //output
    mainArches = arches;
    subArches = middleArches;
    left = Ribs;
    mainBeam = beams;
    middleBeam = middleBeams;
    ribBeam = ribBeams;
# ---------- end c_script ----------
panel = Panel(c_script.out)
data = Data(c_script.left)
panel_2 = Panel(c_script.left)
panel_3 = Panel(c_script.mainArches)
panel_4 = Panel(c_script.subArches)
