# Grasshopper definition cull duplicate lines.gh (Grasshopper 1.0.7)

number_slider = Slider(100, range=0..100)

box = CenterBox(Base=PlaneXY(0, 0, 0), X=number_slider, Y=number_slider, Z=number_slider)
pop3d = Populate3D(Region=box, Count=Slider(1000, range=0..1000), Seed=1)
subset = SubList(List=pop3d, Domain=Slider(18, range=0..100), Wrap=True)  # -> List, Index
subset_2 = SubList(List=pop3d, Domain=Slider(43, range=0..100), Wrap=True)  # -> List, Index
pt = Point(pop3d)
pt_2 = Point(subset.List)
pt_3 = Point(subset_2.List)
merge = Merge(Data1=pt, Data2=pt_2, Data3=pt_3)  # -> flatten(Result)
jitter = Jitter(List=merge, Jitter=1, Seed=2)  # -> Values, Indices

sqgrid = Square(Plane=PlaneXY(0, 0, 0), Size=1, ExtentX=5, ExtentY=5)  # -> Cells, Points
explode = Explode(Curve=sqgrid.Cells, Recursive=True)  # -> Segments, Vertices
flatten = FlattenTree(Tree=explode.Segments, Path="{0}")
c_script = CSharpScript(line=flatten, epsilon=Slider(0.001, range=0..0.001))  # -> out, culledLine; inputs line: list of Line, epsilon: Double
# ---------- c_script: C# ----------
    // cull duplicate lines
    // create empty lists
    var linePts = new List<Point3d>();
    var culledDupLine = new List<Line>();

    for (int i = 0; i < line.Count;i++){
      Point3d A = line[i].From;;
      Point3d B = line[i].To;
      linePts.Add(A);
      linePts.Add(B);
    }
    // extract the end and start points of the lines
    List<Point3d> culledDup = cullDupPts(linePts, epsilon);
    
    // create lines 
    for(int i = 0; i < culledDup.Count;i= i+2 ){
      Line newline = new Line(culledDup[i], culledDup[i + 1]);
      culledDupLine.Add(newline);
    }

    culledLine = culledDupLine;
# ---------- c_script: C# additional code ----------
  // a function to measure the distance between point and a line
  double pointsDistanceSquare (Point3d A, Point3d B){
    double dx = A.X - B.X;
    double dy = A.Y - B.Y;
    double dz = A.Z - B.Z;

    double d = dx * dx + dy * dy + dz * dz;
    return d;
  }

  List<Point3d> cullDupPts(List<Point3d> points, double epsilon){

    // deleting duplicated points in the epsilon distance
    double eps = epsilon * epsilon;
    for(int j = 0; j < points.Count; j= j+2 ){
      Point3d A0 = points[j];
      Point3d B0 = points[j+1];
      
      for(int i = points.Count - 1;i > j; i=i-2){
        Point3d A1 = points[i];
        Point3d B1 = points[i-1];
        if(pointsDistanceSquare(A0, A1) < eps && pointsDistanceSquare(B0, B1) < eps){
          points.RemoveAt(i);
          points.RemoveAt(i-1);
        }
      }
    }
    return points;
  }
# ---------- end c_script ----------
data = Data(c_script.culledLine)
pt_4 = Point(simplify(jitter.Values))
panel = Panel(c_script.out)
c_script_2 = CSharpScript(points=pt_4, epsilon=Slider(0.001, range=0..0.001))  # -> out, culledDup; inputs points: list of Point3d, epsilon: Double
# ---------- c_script_2: C# ----------
    // deleting duplicated points in the epsilon distance
    double eps = epsilon * epsilon;
    for(int j = 0; j < points.Count; j++ ){
      Point3d A = points[j];
      for(int i = points.Count - 1;i > j; i--){
        Point3d B = points[i];
        if(pointsDistanceSquare(A, B) < eps){
          points.RemoveAt(i);
        }
      }
    }
    
    culledDup = points;
# ---------- c_script_2: C# additional code ----------
  double pointsDistanceSquare (Point3d A, Point3d B){
    double dx = A.X - B.X;
    double dy = A.Y - B.Y;
    double dz = A.Z - B.Z;

    double d = dx * dx + dy * dy + dz * dz;
    return d;
  }
# ---------- end c_script_2 ----------
