# Grasshopper definition cull duplicate pts & sorting pts.gh (Grasshopper 1.0.7)

number_slider = Slider(100, range=0..100)

box = CenterBox(Base=PlaneXY(0, 0, 0), X=number_slider, Y=number_slider, Z=number_slider)
pop3d = Populate3D(Region=box, Count=Slider(1000, range=0..1000), Seed=1)
subset = SubList(List=pop3d, Domain=Slider(18, range=0..100), Wrap=True)  # -> List, Index
subset_2 = SubList(List=pop3d, Domain=Slider(43, range=0..100), Wrap=True)  # -> List, Index
pt = Point(pop3d)
pt_2 = Point(subset.List)
pt_3 = Point(subset_2.List)
merge = Merge(Data1=pt, Data2=pt_2, Data3=pt_3)  # -> flatten(Result)
jitter = Jitter(List=merge, Jitter=1, Seed=2)  # -> Values, Indices

pt_4 = Point(simplify(jitter.Values))
c_script = CSharpScript(points=pt_4, epsilon=Slider(0.001, range=0..0.001))  # -> out, culledDup; inputs points: list of Point3d, epsilon: Double
# ---------- c_script: C# ----------
    // deleting duplicated points in the epsilon distance
    double eps = epsilon * epsilon;
    for(int j = 0; j < points.Count; j++ ){
      Point3d A = points[j];
      for(int i = points.Count - 1;i > j; i--){
        Point3d B = points[i];
        if(pointsDistanceSquare(A, B) < eps){
          points.RemoveAt(i);
        }
      }
    }
    
    culledDup = points;
# ---------- c_script: C# additional code ----------
  double pointsDistanceSquare (Point3d A, Point3d B){
    double dx = A.X - B.X;
    double dy = A.Y - B.Y;
    double dz = A.Z - B.Z;

    double d = dx * dx + dy * dy + dz * dz;
    return d;
  }
# ---------- end c_script ----------
pdecon = Deconstruct(Point=c_script.culledDup)  # -> XComponent, YComponent, ZComponent
sort = SortList(Keys=pdecon.XComponent, ValuesA=c_script.culledDup)  # -> Keys, ValuesA
sort_pt = SortPoints(Points=c_script.culledDup)  # -> Points, Indices
c_script_2 = CSharpScript(points=sort_pt.Points)  # -> out, sortedList; inputs points: list of Point3d
# ---------- c_script_2: C# ----------
    List<Point3d> sortedDist = new List<Point3d>();

    //handeling the start point
    
    Point3d lastPt = points[0];
    sortedDist.Add(lastPt);
    points.RemoveAt(0);

    //writeing the for loop
    while (points.Count > 0){
      double maxDist = double.MaxValue;
      int currentIndex = -1;
      for(int i = 0;i < points.Count;i++){
        Point3d B = points[i];
        if(ptsDistance(lastPt, B) < maxDist){
          maxDist = ptsDistance(lastPt, B);
          currentIndex = i;
        }
      }
      Point3d chosenOne = points[currentIndex];
      sortedDist.Add(chosenOne);
      points.RemoveAt(currentIndex);
      lastPt = chosenOne;
    }

    sortedList = sortedDist;
# ---------- c_script_2: C# additional code ----------
  double ptsDistance(Point3d A, Point3d B){
    double dx = A.X - B.X;
    double dy = A.Y - B.Y;
    double dz = A.Z - B.Z;

    double d = Math.Sqrt(dx * dx + dy * dy + dz * dz);
    return d;
  }
# ---------- end c_script_2 ----------
pline = PolyLine(Vertices=c_script_2.sortedList, Closed=False)
panel = Panel(c_script_2.out)
panel_2 = Panel(c_script_2.sortedList)
