# Grasshopper definition points distance to line.gh (Grasshopper 1.0.7)

pt = Point(Point(-1.926868625, 9.948691357, 3.068794163))
pt_2 = Point(Point(-2, 10, 2.913394696))
c_script = CSharpScript(A=pt, B=pt_2)  # -> out, distance; inputs A: Point3d, B: Point3d
# ---------- c_script: C# ----------
    distance = distanceBetweenPts(A,B);
# ---------- c_script: C# additional code ----------
  double distanceBetweenPts(Point3d A,Point3d B){
    double d =Math.Sqrt(
      Math.Pow((A.X - B.X), 2)+
      Math.Pow((A.Y - B.Y), 2) +
      Math.Pow((A.Z - B.Z), 2));
    return d;
  }
# ---------- end c_script ----------
dist = Distance(PointA=pt, PointB=pt_2)
panel = Panel(dist)
panel_2 = Panel(c_script.distance)
