# Grasshopper definition koch.gh (Grasshopper 1.0.7)

xy = XYPlane(Origin=Point(0, 0, 0))
polygon = Polygon(Plane=xy, Radius=Slider(10, range=0..10), Segments=Slider(3, range=0..10), FilletRadius=0)  # -> Polygon, Length
c_script = CSharpScript(triangle=polygon.Polygon, it=Slider(5, range=0..10))  # -> out, koch; inputs triangle: Polyline, it: Int32
# ---------- c_script: C# ----------
    Polyline polyline = triangle;
    for (int i = 0;i < it;i++){
     polyline= kochAlgorithm(polyline, it);
    }
    koch = polyline;
# ---------- c_script: C# additional code ----------
  //this function creates kock algorithm
  Polyline kochAlgorithm (Polyline triangle, int iteration){

    //creating a list of new lines
    List<Point3d> newPts = new List<Point3d>();

    // getting the polyline lines
    Line[] triangleLine = triangle.GetSegments();
    for(int i = 0; i < triangleLine.Length; i++){
      Line line = triangleLine[i];
      Point3d pt0 = line.From;
      Point3d pt1 = line.PointAt(1.0 / 3);
      Point3d pt3 = line.PointAt(2.0 / 3);
      Point3d pt4 = line.To;

      Point3d pt2 = line.PointAt(1.0 / 2);

      Vector3d normalVector = line.UnitTangent;
      normalVector.Rotate(-Math.PI / 2.0, Vector3d.ZAxis);
      double dist = (Math.Sqrt(3.0) / 2.0) * (line.Length / 3.0);

      Transform translationV = Transform.Translation(normalVector * dist);
      pt2.Transform(translationV);

      newPts.Add(pt0);
      newPts.Add(pt1);
      newPts.Add(pt2);
      newPts.Add(pt3);
      newPts.Add(pt4);
    }

    Polyline kockPolyline = new Polyline(newPts);
    return kockPolyline ;
  }
# ---------- end c_script ----------
panel = Panel(c_script.koch)
panel_2 = Panel(c_script.out)
