# Grasshopper definition Sierpinski Tirangle.gh (Grasshopper 1.0.7)

xy = XYPlane(Origin=Point(0, 0, 0))
polygon = Polygon(Plane=xy, Radius=Slider(10, range=0..10), Segments=Slider(3, range=0..10), FilletRadius=0)  # -> Polygon, Length
data = Data(polygon.Polygon)
c_script = CSharpScript(triangle=data, it=Slider(5, range=0..10))  # -> out, serendipity; inputs triangle: Polyline, it: Int32
# ---------- c_script: C# ----------
    // creat empty list
    List < Polyline > triangleList = new List<Polyline>();
    triangleList.Add(triangle);


    for(int i = 0;i < it; i++){
      triangleList = serendipityAlgorithm(triangleList);
    }
    serendipity = triangleList;
# ---------- c_script: C# additional code ----------
  // this function creates serendipity algorithm
  List<Polyline> serendipityAlgorithm (List<Polyline> triangles){
    List<Polyline> smallTriangle = new List<Polyline>();
    for(int k = 0;k < triangles.Count;k++){
      Polyline triangle = triangles[k];

      // creating points of first triangle
      for(int i = 0;i < triangle.Count-1;i++){
        //creating three empty list
        List<Point3d> trianglePts = new List<Point3d>();

        Point3d pt0 = triangle[i];
        trianglePts.Add(pt0);
        for(int j = 0;j < triangle.Count-1;j++){
          if (j != i){
            Line line = new Line(triangle[i], triangle[j]);
            Point3d pt1 = line.PointAt(0.5);
            trianglePts.Add(pt1);
          }
        }
        trianglePts.Add(pt0);
        Polyline newtriangle = new Polyline(trianglePts);
        smallTriangle.Add(newtriangle);
      }
    }
    return smallTriangle;
  }
# ---------- end c_script ----------
boundary = BoundarySurfaces(Edges=c_script.serendipity)
panel = Panel(c_script.out)
panel_2 = Panel(c_script.serendipity)
