# Grasshopper definition chaikin smoothing algorithm.gh (Grasshopper 1.0.7)

pt = ConstructPoint(XCoordinate=Slider(8, range=0..10), YCoordinate=Slider(8, range=0..10), ZCoordinate=Slider(7, range=0..10))
pt_2 = ConstructPoint(XCoordinate=Slider(3, range=0..10), YCoordinate=Slider(3, range=0..10), ZCoordinate=Slider(0, range=0..10))

number_slider = Slider(0, range=-50..50)
number_slider_2 = Slider(-14, range=-50..50)
number_slider_3 = Slider(6, range=0..100)
toggle = BooleanToggle(True)
crvpt = Point([Point(39.94838691, -33.44904674, 0), Point(6.519075833, 46.0220544, 0), Point(66.75204231, 34.14479444, 0)])
firstpt = Point(Point(70.52614124, -55.30620226, 0))
number_slider_4 = Slider(5.7, range=0..50)
pt_3 = Point([Point(-4.585072171, 69.16492505, 0), Point(-55.49503436, 38.79374589, 0), Point(-51.5620759, -1.846824778, 0), Point(-6.551551397, -22.82260319, 0), Point(-33.20826979, -33.0919947, 0)])
toggle_2 = BooleanToggle(False)
crvpt_2 = Point([Point(39.94838691, -33.44904674, 0), Point(6.519075833, 46.0220544, 0), Point(66.75204231, 34.14479444, 0)])
c_script = CSharpScript(pts=pt_3, n=Slider(6, range=0..10), prop=Slider(0.25, range=0..1), isClosed=Toggle(True))  # -> out, ptsOut; inputs pts: list of Point3d, n: Int32, prop: Double, isClosed: Boolean
# ---------- c_script: C# ----------
    List<Point3d> smoothedPts = new List<Point3d>(pts);

    for(int i = 0;i < n;i++){
      smoothedPts = chaikin(smoothedPts, prop, isClosed);
    }
    ptsOut = smoothedPts;
# ---------- c_script: C# additional code ----------
  //Point along line
  Point3d nPt (Point3d firstPt, Point3d secondPt, double parameter){
    Vector3d vector = secondPt - firstPt;
    double nDx = firstPt.X + (vector.X * parameter);
    double nDy = firstPt.Y + (vector.Y * parameter);
    double nDz = firstPt.Z + (vector.Z * parameter);
    Point3d nPt = new Point3d(nDx, nDy, nDz);
    return nPt;
  }


  //chaikin algorithm
  List <Point3d> chaikin (List <Point3d> pts, double t, bool isClosed){

    // a list for saving new polyline vectors
    List<Point3d> newPts = new List<Point3d>();



    // getting lines
    double t0 = t;
    double t1 = 1 - t;

    for(int j = 1; j < pts.Count; j++){
      int i = j - 1;
      // getting the new polyline vectors
      Point3d qPt = nPt(pts[i], pts[j], t0);
      Point3d rPt = nPt(pts[i], pts[j], t1);
      newPts.Add(qPt);
      newPts.Add(rPt);

      if (isClosed && j == pts.Count - 1){
        Point3d qPtCls = nPt(pts[j], pts[0], t0);
        Point3d rPtCls = nPt(pts[j], pts[0], t1);
        newPts.Add(qPtCls);
        newPts.Add(rPtCls);
      }
    }

    if(!isClosed){
      newPts[0] = pts[0];
      newPts[newPts.Count - 1] = pts[pts.Count - 1];
    }


    return newPts;
  }
# ---------- end c_script ----------
pline = PolyLine(Vertices=pt_3, Closed=True)
pline_2 = PolyLine(Vertices=crvpt, Closed=True)
vec = VectorXYZ(XComponent=number_slider_3, YComponent=number_slider_2, ZComponent=number_slider)  # -> Vector, Length
c_script_2 = CSharpScript(firstPt=firstpt, crvPt=crvpt, n=Slider(6, range=0..10), prop=Slider(0.25, range=0..1), isClosed=toggle)  # -> out, ptsOut; inputs firstPt: Point3d, crvPt: list of Point3d, n: Int32, prop: Double, isClosed: Boolean
# ---------- c_script_2: C# ----------
    List<Point3d> controlPts = creatControlPts(firstPt, crvPt);
    List<Point3d> smoothedPts = new List<Point3d>(controlPts);
    for(int i = 0;i < n;i++){
      smoothedPts = chaikin(smoothedPts, prop, isClosed);
    }
    ptsOut = smoothedPts;
# ---------- c_script_2: C# additional code ----------
  /*this function gets a points along a
  curve using a parameter(Normalized Curve version)*/
  Point3d nPtNormalized (Point3d firstPt, Point3d secondPt, double parameter){
    Vector3d vector = secondPt - firstPt;
    double nDx = firstPt.X + (vector.X * parameter);
    double nDy = firstPt.Y + (vector.Y * parameter);
    double nDz = firstPt.Z + (vector.Z * parameter);
    Point3d nPt = new Point3d(nDx, nDy, nDz);
    return nPt;
  }


  /*this function gets a points along a
  curve using a parameter(Standard Version)*/
  Point3d nPtStandard (Point3d firstPt, Point3d secondPt, double d){
    Line line = new Line(firstPt, secondPt);
    double D = line.Length;
    double parameter = d / D;
    Vector3d vector = secondPt - firstPt;
    double nDx = firstPt.X + (vector.X * parameter);
    double nDy = firstPt.Y + (vector.Y * parameter);
    double nDz = firstPt.Z + (vector.Z * parameter);
    Point3d nPt = new Point3d(nDx, nDy, nDz);
    return nPt;
  }



/*this function gets the chaikin algorithm
using a list of control points*/
  List <Point3d> chaikin (List <Point3d> pts, double t, bool isClosed){
    // a list for saving new polyline vectors
    List<Point3d> newPts = new List<Point3d>();
    // getting lines
    double t0 = t;
    double t1 = 1 - t;
    for(int j = 1; j < pts.Count; j++){
      int i = j - 1;
      // getting the new polyline vectors
      Point3d qPt = nPtNormalized(pts[i], pts[j], t0);
      Point3d rPt = nPtNormalized(pts[i], pts[j], t1);
      newPts.Add(qPt);
      newPts.Add(rPt);
      if (isClosed && j == pts.Count - 1){
        Point3d qPtCls = nPtNormalized(pts[j], pts[0], t0);
        Point3d rPtCls = nPtNormalized(pts[j], pts[0], t1);
        newPts.Add(qPtCls);
        newPts.Add(rPtCls);
      }
    }
    //    if(!isClosed){
    //      newPts[0] = pts[0];
    //      newPts[newPts.Count - 1] = pts[pts.Count - 1];
    //    }
    return newPts;
  }



/*this function gets the actual control points
from several points that are on curve and a start point*/
  List<Point3d> creatControlPts (Point3d firstPt, List <Point3d> ptsOnCrv){
    //getting the actual polyline pts
    List<Point3d> crvFinalPts = new List<Point3d>();
    crvFinalPts.Add(firstPt);
    //creating the actual control points
    for(int i = 0;i < ptsOnCrv.Count;i++){
      Vector3d mirrorV = ptsOnCrv[i] - crvFinalPts[i];
      Transform transform = Transform.Mirror(ptsOnCrv[i], mirrorV);
      Point3d newPt = crvFinalPts[i];
      newPt.Transform(transform);
      crvFinalPts.Add(newPt);
    }
    return crvFinalPts;
  }
# ---------- end c_script_2 ----------
pline_3 = PolyLine(Vertices=crvpt_2, Closed=True)
c_script_3 = CSharpScript(
    crvPt=crvpt_2,
    n=Slider(6, range=0..10),
    prop=Slider(0.25, range=0..1),
    isClosed=toggle_2,
    tengantVector=vec.Vector,
    parameter=number_slider_4)  # -> out, ptsOut; inputs crvPt: list of Point3d, n: Int32, prop: Double, isClosed: Boolean, tengantVector: Vector3d, parameter: Double
# ---------- c_script_3: C# ----------
    Point3d firstPt = nPtTangant(crvPt[0],tengantVector, parameter);
    List<Point3d> controlPts = creatControlPts(firstPt, crvPt);
    List<Point3d> smoothedPts = new List<Point3d>(controlPts);
    for(int i = 0;i < n;i++){
      smoothedPts = chaikin(smoothedPts, prop, isClosed);
    }
    ptsOut = smoothedPts;
# ---------- c_script_3: C# additional code ----------
  /*this function gets a points along a
  curve using a parameter(Normalized Curve version)*/
  Point3d nPtNormalized (Point3d firstPt, Point3d secondPt, double parameter){
    Vector3d vector = secondPt - firstPt;
    double nDx = firstPt.X + (vector.X * parameter);
    double nDy = firstPt.Y + (vector.Y * parameter);
    double nDz = firstPt.Z + (vector.Z * parameter);
    Point3d nPt = new Point3d(nDx, nDy, nDz);
    return nPt;
  }


  /*this function gets a points along a
  curve using a parameter(Standard Version)*/
  Point3d nPtTangant (Point3d firstPt, Vector3d tangantV, double d){
    Point3d secondPt = firstPt;
    Transform transform = Rhino.Geometry.Transform.Translation(tangantV * d);
    secondPt.Transform(transform);
    return secondPt;
  }



/*this function gets the chaikin algorithm
using a list of control points*/
  List <Point3d> chaikin (List <Point3d> pts, double t, bool isClosed){
    // a list for saving new polyline vectors
    List<Point3d> newPts = new List<Point3d>();
    // getting lines
    double t0 = t;
    double t1 = 1 - t;
    for(int j = 1; j < pts.Count; j++){
      int i = j - 1;
      // getting the new polyline vectors
      Point3d qPt = nPtNormalized(pts[i], pts[j], t0);
      Point3d rPt = nPtNormalized(pts[i], pts[j], t1);
      newPts.Add(qPt);
      newPts.Add(rPt);
      if (isClosed && j == pts.Count - 1){
        Point3d qPtCls = nPtNormalized(pts[j], pts[0], t0);
        Point3d rPtCls = nPtNormalized(pts[j], pts[0], t1);
        newPts.Add(qPtCls);
        newPts.Add(rPtCls);
      }
    }
    //    if(!isClosed){
    //      newPts[0] = pts[0];
    //      newPts[newPts.Count - 1] = pts[pts.Count - 1];
    //    }
    return newPts;
  }



/*this function gets the actual control points
from several points that are on curve and a start point*/
  List<Point3d> creatControlPts (Point3d firstPt, List <Point3d> ptsOnCrv){
    //getting the actual polyline pts
    List<Point3d> crvFinalPts = new List<Point3d>();
    crvFinalPts.Add(firstPt);
    //creating the actual control points
    for(int i = 0;i < ptsOnCrv.Count;i++){
      Vector3d mirrorV = ptsOnCrv[i] - crvFinalPts[i];
      Transform transform = Transform.Mirror(ptsOnCrv[i], mirrorV);
      Point3d newPt = crvFinalPts[i];
      newPt.Transform(transform);
      crvFinalPts.Add(newPt);
    }
    return crvFinalPts;
  }
# ---------- end c_script_3 ----------
ln = Line(StartPoint=pt_2, EndPoint=pt)
data = Data(c_script.ptsOut)
pline_4 = PolyLine(Vertices=c_script.ptsOut, Closed=True)
pline_5 = PolyLine(Vertices=c_script_2.ptsOut, Closed=toggle)
data_2 = Data(c_script_2.ptsOut)
panel = Panel(c_script.out)
panel_2 = Panel(c_script_2.out)
c_script_4 = CSharpScript(firstPt=pt_2, secondPt=pt, nParameter=Slider(0.29, range=0..1))  # -> out, cPt; inputs firstPt: Point3d, secondPt: Point3d, nParameter: Double
# ---------- c_script_4: C# ----------
    cPt = nPt(firstPt, secondPt, nParameter);
# ---------- c_script_4: C# additional code ----------
  Point3d nPt (Point3d firstPt, Point3d secondPt, double parameter){
    Vector3d vector = secondPt - firstPt;
    double nDx = firstPt.X + (vector.X * parameter);
    double nDy = firstPt.Y + (vector.Y * parameter);
    double nDz = firstPt.Z + (vector.Z * parameter);
    Point3d nPt = new Point3d(nDx, nDy, nDz);
    return nPt;
  }
# ---------- end c_script_4 ----------
panel_3 = Panel(pline_4)
panel_4 = Panel(pline_5)
pline_6 = PolyLine(Vertices=c_script_3.ptsOut, Closed=toggle_2)
data_3 = Data(pline_6)
multiplication = Multiplication(A=vec.Vector, B=number_slider_4)
item = ListItem(List=crvpt_2, Index=0, Wrap=True)
len = Length(Curve=data_3)
pt_4 = Point(c_script_4.cPt)
vdis = VectorDisplay(Anchor=item, Vector=multiplication)
galapagos = Galapagos(fitness=len, gene=[number_slider_2, number_slider_4, number_slider_3, number_slider])
panel_5 = Panel(len)
panel_6 = Panel(c_script_4.out)
